# Grasshopper definition Grasshopper-Hyperboloid.gh (Grasshopper 1.0.7)

series = Series(Start=Slider(0, range=0..100), Step=Slider(1, range=0..1), Count=Slider(25, range=1..50))
construct_point = ConstructPoint(XCoordinate=series, YCoordinate=0, ZCoordinate=0)
construct_point_2 = ConstructPoint(XCoordinate=0, YCoordinate=series, ZCoordinate=0)
reverse_list = ReverseList(List=construct_point_2)
line = Line(StartPoint=construct_point, EndPoint=reverse_list)
